# Dynamo graph DisenoVial_AutomatizacionCompleta.dyn (Dynamo 3.5.2.8914)
# Automatizacion diseno vial Civil 3D 2026

capa_eje_de_camino = StringInput("EJE DE CAMINO")
nombre_alineamiento = StringInput("ALI-EJE")
paso_1_crear_alineamiento = Python(IN[0]=capa_eje_de_camino, IN[1]=nombre_alineamiento)  # IronPython2
# ---------- paso_1_crear_alineamiento.python (124 lines) ----------
# PASO 1: alineamiento NATIVO desde polilinea via PolylineOptions
# (preserva arcos; metodo oficial Autodesk). Firma:
# Alignment.Create(doc, PolylineOptions, name, siteName, layerName, styleName, labelSetName)
# nombres como STRING; siteName=None -> sin sitio.
# OUT = [ [alignment_id, ...], [log...] ]
import clr
clr.AddReference('AcMgd'); clr.AddReference('AcDbMgd'); clr.AddReference('AeccDbMgd')
from Autodesk.AutoCAD.ApplicationServices import Application
from Autodesk.AutoCAD.DatabaseServices import *
from Autodesk.Civil.ApplicationServices import CivilApplication
from Autodesk.Civil.DatabaseServices import Alignment, PolylineOptions

layer_name = IN[0]
ali_base   = IN[1]
DEST_LAYER = 'C-ROAD-CNTR'
doc  = Application.DocumentManager.MdiActiveDocument
db   = doc.Database
cdoc = CivilApplication.ActiveDocument
logs = []

def ensure_layer(name):
    with doc.LockDocument():
        with db.TransactionManager.StartTransaction() as tr:
            lt = tr.GetObject(db.LayerTableId, OpenMode.ForRead)
            if not lt.Has(name):
                lt.UpgradeOpen()
                ltr = LayerTableRecord(); ltr.Name = name
                lt.Add(ltr); tr.AddNewlyCreatedDBObject(ltr, True)
            tr.Commit()

def find_alignment(name):
    with doc.LockDocument():
        with db.TransactionManager.StartTransaction() as tr:
            for aid in cdoc.GetAlignmentIds():
                a = tr.GetObject(aid, OpenMode.ForRead)
                if a.Name.upper() == name.upper():
                    tr.Commit(); return aid
            tr.Commit()
    return None

def delete_alignment(name):
    with doc.LockDocument():
        with db.TransactionManager.StartTransaction() as tr:
            for aid in cdoc.GetAlignmentIds():
                a = tr.GetObject(aid, OpenMode.ForRead)
                if a.Name.upper() == name.upper():
                    a.UpgradeOpen(); a.Erase(); tr.Commit(); return
            tr.Commit()

def length_of(oid):
    with doc.LockDocument():
        with db.TransactionManager.StartTransaction() as tr:
            try: L = tr.GetObject(oid, OpenMode.ForRead).Length
            except: L = 0.0
            tr.Commit()
    return L

# pares (estiloAlineamiento, conjuntoEtiquetas) para EN/ES
STYLES = [('Standard', 'Standard'),
          (u'Est\xe1ndar', u'Est\xe1ndar'),
          ('Standard', '_No Labels'),
          (u'Est\xe1ndar', u'_Sin etiquetas'),
          ('Standard', None)]

def create_native(pid, name):
    errs = []
    for sN, lN in STYLES:
        try:
            plops = PolylineOptions()
            plops.AddCurvesBetweenTangents = False
            plops.EraseExistingEntities = False
            plops.PlineId = pid
            with doc.LockDocument():
                aid = Alignment.Create(cdoc, plops, name, None, DEST_LAYER, sN, lN)
            return aid, None
        except Exception as e:
            errs.append((sN or 'None') + '/' + (lN or 'None') + ':' + str(e))
    return None, ' | '.join(errs)

try:
    plines = []
    with doc.LockDocument():
        with db.TransactionManager.StartTransaction() as tr:
            bt  = tr.GetObject(db.BlockTableId, OpenMode.ForRead)
            btr = tr.GetObject(bt[BlockTableRecord.ModelSpace], OpenMode.ForRead)
            for oid in btr:
                o = tr.GetObject(oid, OpenMode.ForRead)
                if isinstance(o, (Polyline, Polyline2d, Polyline3d)):
                    plines.append(oid)
            tr.Commit()

    if not plines:
        OUT = [[], [u'[ERROR P1] No hay ninguna polilinea en el modelo.']]
    else:
        logs.append(u'[INFO P1] Polilineas encontradas: ' + str(len(plines)))
        ensure_layer(DEST_LAYER)
        aids = []
        one = len(plines) == 1
        for k, pid in enumerate(plines):
            name = ali_base if one else (ali_base + u'-%02d' % (k + 1))
            Lp = length_of(pid)
            existing = find_alignment(name)
            if existing is not None:
                aids.append(existing)
                La = length_of(existing)
                logs.append(u'[OK P1] %s conservado (L=%.3f).' % (name, La))
                continue
            aid, err = create_native(pid, name)
            if aid is None:
                logs.append(u'[WARN P1] ' + name + u': ' + err)
                continue
            aids.append(aid)
            La = length_of(aid)
            d  = abs(Lp - La)
            est = u'OK' if (Lp > 0 and d <= max(0.05, Lp * 0.002)) else u'REVISAR'
            logs.append(u'[OK P1] %s creado | L.poli=%.3f L.ali=%.3f dif=%.3f -> %s'
                        % (name, Lp, La, d, est))
        if not aids:
            logs.append(u'[ERROR P1] Ninguna polilinea pudo convertirse en alineamiento.')
        else:
            logs.append(u'[INFO P1] Alineamientos creados: ' + str(len(aids)))
        OUT = [aids, logs]
except Exception as ex:
    OUT = [[], logs + [u'[ERROR P1] Global: ' + str(ex)]]
# ----------------------------------------
nombre_rasante = StringInput("RASANTE")
nombre_assembly = StringInput("camino")
nombre_superficie_tn = StringInput("TN")
nombre_superficie_sello = StringInput("SELLO")
delta_metros = DoubleInput(0.3)
paso_2_crear_sello = Python(IN[0]=nombre_superficie_tn, IN[1]=nombre_superficie_sello, IN[2]=delta_metros, IN[3]=paso_1_crear_alineamiento)  # IronPython2
# ---------- paso_2_crear_sello.python (90 lines) ----------
# PASO 2: SELLO = TN - delta
# TinSurface.Create espera (nombre, estiloId), NO el CivilDocument.
# Create* fuera de transaccion abierta. Prueba varias firmas y reporta error real.
# OUT = [sello_id, tn_id, logs]
import clr
clr.AddReference('AcMgd'); clr.AddReference('AcDbMgd'); clr.AddReference('AeccDbMgd')
from Autodesk.AutoCAD.ApplicationServices import Application
from Autodesk.AutoCAD.DatabaseServices import *
from Autodesk.AutoCAD.Geometry import Point3d, Point3dCollection
from Autodesk.Civil.ApplicationServices import CivilApplication
from Autodesk.Civil.DatabaseServices import TinSurface

tn_name=IN[0]; sello_name=IN[1]; delta=float(IN[2]); p1=IN[3]
logs=list(p1[1]) if (p1 and len(p1)>1 and p1[1]) else []
doc=Application.DocumentManager.MdiActiveDocument
db=doc.Database
cdoc=CivilApplication.ActiveDocument

def sty(col,*ns):
    for n in ns:
        try: return col[n]
        except: pass
    for s in col: return s
    return ObjectId.Null

def find_surf(name):
    with doc.LockDocument():
        with db.TransactionManager.StartTransaction() as tr:
            r=None
            for sid in cdoc.GetSurfaceIds():
                s=tr.GetObject(sid,OpenMode.ForRead)
                if s.Name.upper()==name.upper(): r=sid; break
            tr.Commit()
    return r

def erase_surf(sid):
    with doc.LockDocument():
        with db.TransactionManager.StartTransaction() as tr:
            tr.GetObject(sid,OpenMode.ForWrite).Erase(); tr.Commit()

def read_verts(sid,dz):
    pts=Point3dCollection()
    with doc.LockDocument():
        with db.TransactionManager.StartTransaction() as tr:
            s=tr.GetObject(sid,OpenMode.ForRead)
            for v in s.Vertices:
                L=v.Location
                pts.Add(Point3d(L.X,L.Y,L.Z-dz))
            tr.Commit()
    return pts

def create_surf(name,styleId):
    errs=[]
    sigs=[
        lambda: TinSurface.Create(name,styleId),
        lambda: TinSurface.Create(db,name),
    ]
    for f in sigs:
        try:
            with doc.LockDocument(): return f(),None
        except Exception as e: errs.append(str(e))
    return None,' | '.join(errs)

try:
    if not p1 or not p1[0]:
        OUT=[None,None,logs+[u'[SKIP P2] PASO 1 sin alineamiento.']]
    else:
        tn_id=find_surf(tn_name)
        if tn_id is None:
            raise ValueError(u'Superficie TN no encontrada: '+tn_name)
        ex=find_surf(sello_name)
        if ex is not None: erase_surf(ex)
        st=sty(cdoc.Styles.SurfaceStyles,'Standard',u'Est\xe1ndar','Estandar')
        pts=read_verts(tn_id,delta)
        sid,err=create_surf(sello_name,st)
        if sid is None:
            raise ValueError(u'TinSurface.Create fallo: '+err)
        with doc.LockDocument():
            with db.TransactionManager.StartTransaction() as tr:
                srf=tr.GetObject(sid,OpenMode.ForWrite)
                if st!=ObjectId.Null:
                    try: srf.StyleId=st
                    except: pass
                srf.AddVertices(pts)
                srf.Rebuild()
                tr.Commit()
        logs.append(u'[OK P2] SELLO = TN - %.3f m (%d vert.)'%(delta,pts.Count))
        OUT=[sid,tn_id,logs]
except Exception as ex:
    OUT=[None,None,logs+[u'[ERROR P2] '+str(ex)]]
# ----------------------------------------
paso_3_vista_de_perfil = Python(IN[0]=paso_1_crear_alineamiento, IN[1]=paso_2_crear_sello)  # IronPython2
# ---------- paso_3_vista_de_perfil.python (105 lines) ----------
# PASO 3: una vista de perfil (TN + SELLO) por CADA alineamiento
# Create* fuera de transaccion abierta; prueba varias firmas; reporta error real.
# OUT = [ [pv_id,...], logs ]
import clr
clr.AddReference('AcMgd'); clr.AddReference('AcDbMgd'); clr.AddReference('AeccDbMgd')
from Autodesk.AutoCAD.ApplicationServices import Application
from Autodesk.AutoCAD.DatabaseServices import *
from Autodesk.AutoCAD.Geometry import Point3d
from Autodesk.Civil.ApplicationServices import CivilApplication
from Autodesk.Civil.DatabaseServices import Profile, ProfileView

p1=IN[0]; p2=IN[1]
logs=list(p2[2]) if (p2 and len(p2)>2 and p2[2]) else []
doc=Application.DocumentManager.MdiActiveDocument
db=doc.Database
cdoc=CivilApplication.ActiveDocument

def sty(col,*ns):
    for n in ns:
        try: return col[n]
        except: pass
    for s in col: return s
    return ObjectId.Null

def ali_info(aid):
    with doc.LockDocument():
        with db.TransactionManager.StartTransaction() as tr:
            a=tr.GetObject(aid,OpenMode.ForRead)
            nm=a.Name
            ext=a.GeometricExtents
            mnx,mny=ext.MinPoint.X,ext.MinPoint.Y
            mxx,mxy=ext.MaxPoint.X,ext.MaxPoint.Y
            existing=[tr.GetObject(pid,OpenMode.ForRead).Name for pid in a.GetProfileIds()]
            tr.Commit()
    return nm,mnx,mny,mxx,mxy,existing

def make_profile(name,aid,sid,lay):
    ps=sty(cdoc.Styles.ProfileStyles,'Standard',u'Est\xe1ndar','Estandar')
    ls=sty(cdoc.Styles.LabelSetStyles.ProfileLabelSetStyles,'_No Labels','Standard')
    errs=[]
    sigs=[
        lambda: Profile.CreateFromSurface(name,aid,sid,lay,ps,ls),
        lambda: Profile.CreateFromSurface(cdoc,name,aid,sid,lay,ps,ls),
    ]
    for f in sigs:
        try:
            with doc.LockDocument(): return f(),None
        except Exception as e: errs.append(str(e))
    return None,' | '.join(errs)

def make_pv(name,aid,x,y,pvs):
    pt=Point3d(x,y,0.0)
    errs=[]
    sigs=[
        lambda: ProfileView.Create(aid,pt),
        lambda: ProfileView.Create(cdoc,aid,pt),
        lambda: ProfileView.Create(name,aid,pt,pvs),
    ]
    for f in sigs:
        try:
            with doc.LockDocument(): return f(),None
        except Exception as e: errs.append(str(e))
    return None,' | '.join(errs)

try:
    aids=p1[0] if (p1 and p1[0]) else []
    if not aids:
        OUT=[[],logs+[u'[SKIP P3] PASO 1 sin alineamientos.']]
    elif not p2 or p2[0] is None:
        OUT=[[],logs+[u'[SKIP P3] PASO 2 sin SELLO.']]
    else:
        sello_id=p2[0]; tn_id=p2[1]
        pvs=sty(cdoc.Styles.ProfileViewStyles,'Standard',u'Est\xe1ndar','Estandar')
        cl=db.Clayer
        pv_ids=[]
        for k,aid in enumerate(aids):
            try:
                nm,mnx,mny,mxx,mxy,existing=ali_info(aid)
                nTN=u'PERF-TN-'+nm; nSE=u'PERF-SELLO-'+nm
                if nTN not in existing:
                    r,e=make_profile(nTN,aid,tn_id,cl)
                    if r is None: logs.append(u'[WARN P3] perfil TN '+nm+u': '+e)
                if nSE not in existing:
                    r,e=make_profile(nSE,aid,sello_id,cl)
                    if r is None: logs.append(u'[WARN P3] perfil SELLO '+nm+u': '+e)
                px=mxx+150.0; py=mny-k*250.0
                pid,e=make_pv(u'PV-'+nm,aid,px,py,pvs)
                if pid is None:
                    logs.append(u'[WARN P3] vista '+nm+u': '+e); continue
                with doc.LockDocument():
                    with db.TransactionManager.StartTransaction() as tr:
                        pv=tr.GetObject(pid,OpenMode.ForWrite)
                        try: pv.Name=u'PV-'+nm
                        except: pass
                        if pvs!=ObjectId.Null:
                            try: pv.StyleId=pvs
                            except: pass
                        tr.Commit()
                pv_ids.append(pid)
            except Exception as e:
                logs.append(u'[WARN P3] '+str(e))
        logs.append(u'[OK P3] Vistas de perfil creadas: '+str(len(pv_ids)))
        OUT=[pv_ids,logs]
except Exception as ex:
    OUT=[[],logs+[u'[ERROR P3] '+str(ex)]]
# ----------------------------------------
paso_4_crear_corredor = Python(IN[0]=paso_1_crear_alineamiento, IN[1]=nombre_rasante, IN[2]=nombre_assembly, IN[3]=paso_2_crear_sello, IN[4]=paso_3_vista_de_perfil)  # IronPython2
# ---------- paso_4_crear_corredor.python (112 lines) ----------
# PASO 4: corredor por cada alineamiento usando PERF-TN como perfil base
# API correcta: cdoc.CorridorCollection.Add(...) NO Corridor.Create()
#               cdoc.AssemblyCollection para buscar el assembly
# OUT = [ [corridor_id,...], logs ]
import clr
clr.AddReference('AcMgd'); clr.AddReference('AcDbMgd'); clr.AddReference('AeccDbMgd')
from Autodesk.AutoCAD.ApplicationServices import Application
from Autodesk.AutoCAD.DatabaseServices import *
from Autodesk.Civil.ApplicationServices import CivilApplication

p1=IN[0]; profile_name=IN[1]; assembly_name=IN[2]; p2=IN[3]; p3=IN[4]
logs=list(p3[1]) if (p3 and len(p3)>1 and p3[1]) else []
doc=Application.DocumentManager.MdiActiveDocument
db=doc.Database
cdoc=CivilApplication.ActiveDocument

def sty(col,*ns):
    for n in ns:
        try: return col[n]
        except: pass
    for s in col: return s
    return ObjectId.Null

def norm(s):
    import unicodedata
    return ''.join(c for c in unicodedata.normalize('NFD',unicode(s)) if unicodedata.category(c)!='Mn').upper()

def find_assembly(name):
    tgt=norm(name)
    with doc.LockDocument():
        with db.TransactionManager.StartTransaction() as tr:
            r=None; names=[]
            for oid in cdoc.AssemblyCollection:
                a=tr.GetObject(oid,OpenMode.ForRead)
                names.append(a.Name)
                if norm(a.Name)==tgt: r=oid; break
            tr.Commit()
    return r,names

def ali_data(aid):
    with doc.LockDocument():
        with db.TransactionManager.StartTransaction() as tr:
            a=tr.GetObject(aid,OpenMode.ForRead)
            nm=a.Name; s0=a.StartingStation; s1=a.EndingStation
            pr=None; pnames=[]
            tn_key=u'PERF-TN-'+nm
            for pid in a.GetProfileIds():
                pn=tr.GetObject(pid,OpenMode.ForRead).Name
                pnames.append(pn)
                if pn.upper()==tn_key.upper(): pr=pid
            tr.Commit()
    return nm,s0,s1,pr,pnames

def delete_corridor(name):
    with doc.LockDocument():
        with db.TransactionManager.StartTransaction() as tr:
            for cid in cdoc.CorridorCollection:
                c=tr.GetObject(cid,OpenMode.ForRead)
                if c.Name.upper()==name.upper():
                    c.UpgradeOpen(); c.Erase(); tr.Commit(); return
            tr.Commit()

def make_corridor(corNm,blNm,aid,pr,regNm,asmId):
    errs=[]
    sigs=[
        lambda: cdoc.CorridorCollection.Add(corNm,blNm,aid,pr,regNm,asmId),
        lambda: cdoc.CorridorCollection.Add(corNm,blNm,aid,pr),
        lambda: cdoc.CorridorCollection.Add(corNm),
    ]
    for f in sigs:
        try:
            with doc.LockDocument(): return f(),None
        except Exception as e: errs.append(str(e))
    return None,' | '.join(errs)

try:
    aids=p1[0] if (p1 and p1[0]) else []
    if not aids:
        OUT=[[],logs+[u'[SKIP P4] PASO 1 sin alineamientos.']]
    elif not p3 or not p3[0]:
        OUT=[[],logs+[u'[SKIP P4] PASO 3 sin vistas de perfil.']]
    else:
        asm_id,asm_names=find_assembly(assembly_name)
        if asm_id is None:
            disp=', '.join(asm_names) if asm_names else u'(ninguno en el modelo)'
            raise ValueError(u'Assembly "'+assembly_name+u'" no encontrado. Disponibles: '+disp)
        cor_ids=[]
        for aid in aids:
            nm,s0,s1,pr,pnames=ali_data(aid)
            if pr is None:
                disp=', '.join(pnames) if pnames else u'(sin perfiles)'
                logs.append(u'[WARN P4] '+nm+u': perfil PERF-TN-'+nm+u' no encontrado. Disponibles: '+disp)
                continue
            try: delete_corridor(u'COR-'+nm)
            except: pass
            cid,err=make_corridor(u'COR-'+nm,u'BL-'+nm,aid,pr,u'REG-1',asm_id)
            if cid is None:
                logs.append(u'[WARN P4] '+nm+u': CorridorCollection.Add fallo: '+err)
                continue
            try:
                with doc.LockDocument():
                    with db.TransactionManager.StartTransaction() as tr:
                        tr.GetObject(cid,OpenMode.ForWrite).Rebuild()
                        tr.Commit()
            except Exception as re:
                logs.append(u'[WARN P4] '+nm+u' Rebuild: '+str(re))
            cor_ids.append(cid)
            logs.append(u'[OK P4] Corredor COR-'+nm+u' creado.')
        logs.append(u'[INFO P4] Corredores creados: '+str(len(cor_ids))+u' de '+str(len(aids)))
        OUT=[cor_ids,logs]
except Exception as ex:
    OUT=[[],logs+[u'[ERROR P4] '+str(ex)]]
# ----------------------------------------
watch_resultado = Watch(paso_4_crear_corredor)
plataformas_json = CodeBlock(Name="Plataformas JSON") { [{"name":"PLT-01","pk_start":500,"pk_end":650,"width":8,"side":"right"},{"name":"PLT-02","pk_start":1200,"pk_end":1380,"width":10,"side":"left"}] }  # graph input
paso_6_compensar_tierras_kv_800 = Python(Name="PASO 6: Compensar Tierras KV=800")  # IronPython2; unwired: IN[0], IN[1], IN[2], IN[3], IN[4]
# ---------- paso_6_compensar_tierras_kv_800.python (121 lines) ----------
# PASO 6: Compensar movimiento de tierra y calcular acuerdos KV=800
# IN[0] = corridor_id  (lista de corridor_ids del PASO 4)
# IN[1] = alignment_id (lista de alignment_ids del PASO 1)
# IN[2] = perfil TN name (str)
# IN[3] = nombre superficie TN (str)
# IN[4] = JSON de plataformas (str)
# OUT   = [platforms_list, logs]

import clr, sys, json, os
clr.AddReference('AcMgd'); clr.AddReference('AcDbMgd'); clr.AddReference('AeccDbMgd')
from Autodesk.AutoCAD.ApplicationServices import Application
from Autodesk.AutoCAD.DatabaseServices import OpenMode
from Autodesk.Civil.ApplicationServices import CivilApplication

# Importar módulo platforms.py (debe estar en el mismo directorio que el .dyn)
_dyn_dir = os.path.dirname(os.path.abspath(__file__)) if '__file__' in dir() else r'C:\Civil3D'
if _dyn_dir not in sys.path:
    sys.path.insert(0, _dyn_dir)

try:
    import platforms as plt_mod
    from platforms import Platform, compensate_earthwork_all, KV_DEFAULT
except ImportError as ie:
    OUT = [[], [f"ERROR importando platforms.py: {ie}. Copiar platforms.py junto al .dyn"]]
    raise SystemExit(0)

logs = []

corridor_ids  = IN[0] if isinstance(IN[0], list) else [IN[0]]
alignment_ids = IN[1] if isinstance(IN[1], list) else [IN[1]]
profile_name  = str(IN[2])
surface_name  = str(IN[3])
platform_json = str(IN[4])

doc   = Application.DocumentManager.MdiActiveDocument
db    = doc.Database
cdoc  = CivilApplication.ActiveDocument

# Resolver surface_id
surface_id = None
for sid in cdoc.GetSurfaceIds():
    with db.TransactionManager.StartTransaction() as tr:
        s = tr.GetObject(sid, OpenMode.ForRead)
        if s.Name.upper() == surface_name.upper():
            surface_id = sid
            tr.Commit()
            break
        tr.Commit()
if surface_id is None:
    OUT = [[], [f"ERROR: Superficie '{surface_name}' no encontrada"]]
    raise SystemExit(0)

# Parsear plataformas desde JSON
try:
    plt_defs = json.loads(platform_json)
except Exception as ex:
    OUT = [[], [f"ERROR JSON plataformas: {ex}"]]
    raise SystemExit(0)

platforms = []
for d in plt_defs:
    try:
        p = Platform(
            name      = d['name'],
            pk_start  = float(d['pk_start']),
            pk_end    = float(d['pk_end']),
            width     = float(d['width']),
            side      = d.get('side', 'right'),
            slope_pct = float(d.get('slope_pct', 2.0)),
            elevation = d.get('elevation', None),
        )
        platforms.append(p)
        logs.append(f"Plataforma definida: {p}")
    except Exception as ex:
        logs.append(f"ERROR definiendo plataforma {d.get('name','?')}: {ex}")

if not platforms:
    OUT = [[], logs + ["ERROR: Sin plataformas válidas"]]
    raise SystemExit(0)

# Compensar tierras en el primer alineamiento (o todos si hay múltiples)
all_results = []
for ali_id in alignment_ids:
    # Buscar profile_id en el alineamiento
    profile_id = None
    with db.TransactionManager.StartTransaction() as tr:
        ali = tr.GetObject(ali_id, OpenMode.ForRead)
        for pid in ali.GetProfileIds():
            prof = tr.GetObject(pid, OpenMode.ForRead)
            if prof.Name.upper() == profile_name.upper():
                profile_id = pid
                tr.Commit()
                break
        else:
            tr.Commit()

    if profile_id is None:
        logs.append(f"AVISO: Rasante '{profile_name}' no encontrada en alineamiento — usando sin perfil")

    results = compensate_earthwork_all(
        surface_id, ali_id, platforms,
        profile_id=profile_id,
        kv=KV_DEFAULT,
        road_half_width=4.0,
        spacing=5.0,
    )
    all_results += results
    for r in results:
        logs.append(
            f"[{r['name']}] Cota={r.get('optimal_elevation','-'):.3f}m  "
            f"Corte={r.get('volume_cut',0):.0f}m³  "
            f"Relleno={r.get('volume_fill',0):.0f}m³  "
            f"Balance={r.get('balance_m3',0):+.0f}m³  "
            f"L_ent={r.get('L_entry',0):.1f}m  L_sal={r.get('L_exit',0):.1f}m"
        )
        if r.get('warnings'):
            logs += [f"  AVISO: {w}" for w in r['warnings']]
        if r.get('errors'):
            logs += [f"  ERROR: {e}" for e in r['errors']]

OUT = [platforms, logs]
# ----------------------------------------
paso_7_integrar_plataformas = Python(Name="PASO 7: Integrar Plataformas al Corredor")  # IronPython2; unwired: IN[0], IN[1], IN[2], IN[3], IN[4]
# ---------- paso_7_integrar_plataformas.python (77 lines) ----------
# PASO 7: Integrar Plataformas al Corredor (PIPs + Regiones + FL + TIN)
# IN[0] = platforms  (lista Platform del PASO 6)
# IN[1] = corridor_ids (del PASO 4)
# IN[2] = alignment_ids (del PASO 1)
# IN[3] = nombre rasante (str)
# IN[4] = nombre assembly de plataforma (str)
# OUT   = [surface_ids_plataforma, logs]

import clr, sys, os
clr.AddReference('AcMgd'); clr.AddReference('AcDbMgd'); clr.AddReference('AeccDbMgd')
from Autodesk.AutoCAD.ApplicationServices import Application
from Autodesk.AutoCAD.DatabaseServices import OpenMode
from Autodesk.Civil.ApplicationServices import CivilApplication

_dyn_dir = os.path.dirname(os.path.abspath(__file__)) if '__file__' in dir() else r'C:\Civil3D'
if _dyn_dir not in sys.path:
    sys.path.insert(0, _dyn_dir)

try:
    from platforms import (
        add_platform_pips_to_profile,
        add_platform_regions_to_corridor,
        create_platform_feature_lines,
        create_platform_tin_surface,
        KV_DEFAULT,
    )
except ImportError as ie:
    OUT = [[], [f"ERROR importando platforms.py: {ie}"]]
    raise SystemExit(0)

logs = []

platforms     = IN[0] if isinstance(IN[0], list) else [IN[0]]
corridor_ids  = IN[1] if isinstance(IN[1], list) else [IN[1]]
alignment_ids = IN[2] if isinstance(IN[2], list) else [IN[2]]
profile_name  = str(IN[3])
asm_name      = str(IN[4])

doc  = Application.DocumentManager.MdiActiveDocument
db   = doc.Database
cdoc = CivilApplication.ActiveDocument

for ali_id, cor_id in zip(alignment_ids, corridor_ids):
    # Buscar perfil de rasante
    profile_id = None
    with db.TransactionManager.StartTransaction() as tr:
        ali = tr.GetObject(ali_id, OpenMode.ForRead)
        for pid in ali.GetProfileIds():
            prof = tr.GetObject(pid, OpenMode.ForRead)
            if prof.Name.upper() == profile_name.upper():
                profile_id = pid
                tr.Commit()
                break
        else:
            tr.Commit()

    # A) Insertar PIPs en la rasante
    if profile_id:
        pip_logs = add_platform_pips_to_profile(ali_id, profile_id, platforms, KV_DEFAULT)
        logs += pip_logs
    else:
        logs.append(f"AVISO: Rasante '{profile_name}' no encontrada — saltando PIPs")

    # B) Regiones de corredor con assembly de plataforma
    cor_logs = add_platform_regions_to_corridor(cor_id, ali_id, asm_name, platforms)
    logs += cor_logs

    # C) Feature Lines de bordes
    fl_logs = create_platform_feature_lines(ali_id, platforms, spacing=5.0)
    logs += fl_logs

    # D) Superficie TIN de plataforma
    tin_logs = create_platform_tin_surface(ali_id, platforms, road_half_width=4.0, spacing=5.0)
    logs += tin_logs

logs.append("PASO 7 completado — Plataformas integradas al corredor.")
OUT = [platforms, logs]
# ----------------------------------------
